# Dynamo graph Samples-Simple-GetTaskById.dyn (Dynamo 1.3.0.875)

# note: Replace below with your Asana API key.
string = StringInput("Bearer 0/xxxxxxxxxxxxxxxxxxxxxxxxxxxxxxxxxxxxxx")
client = Asana.Client.Client(string)
# note: Replace below with an Asana task ID. This can easily be found by looking at  the last portion of the URL in the browser when viewing a task in the Asana web application.
string_2 = StringInput("198900482693483")
getTaskById = Asana.Client.GetTaskById(client, string_2)
notes = Asana.Classes.Task.Notes(getTaskById)
watch = Watch(notes)
name = Asana.Classes.Task.Name(getTaskById)
watch_2 = Watch(name)
# note: The integration returns Asana objects which need to be deconstructed to access their properties.
# Note : also works with DesignScript.
id = Asana.Classes.Task.Id(getTaskById)
watch_3 = Watch(id)
createdAt = Asana.Classes.Task.CreatedAt(getTaskById)
watch_4 = Watch(createdAt)
code_block = CodeBlock(task=getTaskById) { task.Id; }
watch_5 = Watch(code_block)
projects = Asana.Classes.Task.Projects(getTaskById)
id_2 = Asana.Classes.Project.Id(projects)
watch_6 = Watch(id_2)
name_2 = Asana.Classes.Project.Name(projects)
watch_7 = Watch(name_2)
